# Grasshopper definition Human UI.gh (Grasshopper 1.0.8)
# plug-ins: Human UI

c_script = CSharpScript()  # -> out, a; disabled
# ---------- c_script: C# ----------
// Grasshopper Script Instance
#region Usings
using System;
using System.Linq;
using System.Collections;
using System.Collections.Generic;
using System.Drawing;

using Rhino;
using Rhino.Geometry;

using Grasshopper;
using Grasshopper.Kernel;
using Grasshopper.Kernel.Data;
using Grasshopper.Kernel.Types;
#endregion

public class Script_Instance : GH_ScriptInstance
{
    #region Notes
    /*
      Members:
        RhinoDoc RhinoDocument
        GH_Document GrasshopperDocument
        IGH_Component Component
        int Iteration

      Methods (Virtual & overridable):
        Print(string text)
        Print(string format, params object[] args)
        Reflect(object obj)
        Reflect(object obj, string method_name)
    */
    #endregion

    private void RunScript(ref object a)
    {
        var editor = Grasshopper.Instances.DocumentEditor;
        editor.WindowState = System.Windows.Forms.FormWindowState.Minimized;
        editor.Hide();
        a = null;
    }
}
# ---------- end c_script ----------
c_script_2 = CSharpScript()  # -> out, a; disabled
# ---------- c_script_2: C# ----------
// Grasshopper Script Instance
#region Usings
using System;
using System.Linq;
using System.Collections;
using System.Collections.Generic;
using System.Drawing;

using Rhino;
using Rhino.Geometry;

using Grasshopper;
using Grasshopper.Kernel;
using Grasshopper.Kernel.Data;
using Grasshopper.Kernel.Types;
#endregion

public class Script_Instance : GH_ScriptInstance
{
    #region Notes
    /*
      Members:
        RhinoDoc RhinoDocument
        GH_Document GrasshopperDocument
        IGH_Component Component
        int Iteration

      Methods (Virtual & overridable):
        Print(string text)
        Print(string format, params object[] args)
        Reflect(object obj)
        Reflect(object obj, string method_name)
    */
    #endregion

    private void RunScript(ref object a)
    {
        if (!_hasRun)
        {
            _hasRun = true;
            var editor = Grasshopper.Instances.DocumentEditor;
            editor.WindowState = System.Windows.Forms.FormWindowState.Minimized;
            editor.Hide();
        }
        a = null;
    }

    private static bool _hasRun = false;
}
# ---------- end c_script_2 ----------
c_script_3 = CSharpScript()  # -> out, b, a
# ---------- c_script_3: C# ----------
// Grasshopper Script Instance
#region Usings
using System;
using System.Linq;
using System.Collections;
using System.Collections.Generic;
using System.Drawing;

using Rhino;
using Rhino.Geometry;

using Grasshopper;
using Grasshopper.Kernel;
using Grasshopper.Kernel.Data;
using Grasshopper.Kernel.Types;
#endregion

public class Script_Instance : GH_ScriptInstance
{
    #region Notes
    /*
      Members:
        RhinoDoc RhinoDocument
        GH_Document GrasshopperDocument
        IGH_Component Component
        int Iteration

      Methods (Virtual & overridable):
        Print(string text)
        Print(string format, params object[] args)
        Reflect(object obj)
        Reflect(object obj, string method_name)
    */
    #endregion

    private void RunScript(ref object b, ref object a)
    {
        if (!_hasRun)
        {
            _hasRun = true;
            var editor = Grasshopper.Instances.DocumentEditor;
            editor.Hide();
        }
        a = null;
    }

    // Register a cleanup handler the first time this runs
    static Script_Instance()
    {
        Rhino.RhinoApp.Closing += (s, e) =>
        {
            var editor = Grasshopper.Instances.DocumentEditor;
            if (editor != null)
            {
                editor.Show();
                editor.WindowState = System.Windows.Forms.FormWindowState.Normal;
            }
        };
    }

    private static bool _hasRun = false;
}
# ---------- end c_script_3 ----------

create_slider = CreateSlider(Slider=Slider(0, range=0..1), ShowBounds=False, ShowTicks=False, ShowTooltip=False, ShowValLabel=True, showLabel=True)
create_color_picker = CreateColorPicker()
create_stack = CreateStack(UIElements=create_slider, Horizontal=True)
launch_window = LaunchWindow(
    Show=Toggle(True),
    Name="Control Window",
    Width="370",
    Height="400",
    ShowIcon=True,
    AlwaysOn=False,
    ChildStatus=1,
    EnableHorizScroll=False)
create_text_box = CreateTextBox(Label="Email", UpdateButton=True, showLabel=True)
create_button = CreateButton(ButtonName="test", ButtonStyle=0)
trigger = Trigger(Interval=-1000, TimerInterval=1000)
add_elements = AddElements(
    Window=launch_window,
    Elements=flatten([create_stack, create_color_picker, create_button, create_text_box]),
    DoVLChecking=True)  # -> AddedElements, ElementNames
value_listener = ValueListener(Elements=create_text_box, SomeProperty=True)  # -> Values, Indices
value_listener_2 = ValueListener(Elements=create_button, SomeProperty=True)  # -> Values, Indices
python_3_script = Python3Script(trigger=value_listener_2.Values)  # -> out, a
# ---------- python_3_script: Python ----------
import Rhino
import Grasshopper
import Grasshopper.Kernel.Types as GHT

if trigger:
    selected = Rhino.RhinoDoc.ActiveDoc.Objects.GetSelectedObjects(False, False)
    for obj in selected:
        if obj.Geometry.ObjectType == Rhino.DocObjects.ObjectType.Curve:
            curve = obj.Geometry
            doc = Grasshopper.Instances.ActiveCanvas.Document
            for gh_obj in doc.Objects:
                if gh_obj.NickName == "MyCurve":
                    gh_obj.PersistentData.Clear()
                    gh_obj.PersistentData.Append(
                        GHT.GH_Curve(curve), 
                        Grasshopper.Kernel.Data.GH_Path(0)
                    )
                    gh_obj.ExpireSolution(True)
                    doc.NewSolution(False)
                    break
            break
# ---------- end python_3_script ----------
python_3_script_2 = Python3Script(trigger=create_button)  # -> out, a; disabled
# ---------- python_3_script_2: Python ----------
import Rhino
import Grasshopper
import Grasshopper.Kernel.Types as GHT

print("trigger value:", trigger)

if trigger is not None and trigger != 0:
    selected = list(Rhino.RhinoDoc.ActiveDoc.Objects.GetSelectedObjects(False, False))
    print("Selected objects:", len(selected))
    for obj in selected:
        if obj.Geometry.ObjectType == Rhino.DocObjects.ObjectType.Curve:
            curve = obj.Geometry
            doc = Grasshopper.Instances.ActiveCanvas.Document
            for gh_obj in doc.Objects:
                if gh_obj.NickName == "MyCurve":
                    gh_obj.PersistentData.Clear()
                    gh_obj.PersistentData.Append(
                        GHT.GH_Curve(curve),
                        Grasshopper.Kernel.Data.GH_Path(0)
                    )
                    gh_obj.ExpireSolution(True)
                    doc.NewSolution(False)
                    break
        break
# ---------- end python_3_script_2 ----------
mycurve = Curve(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)
panel = Panel(value_listener.Values)
linear_array = LinearArray(Geometry=mycurve, Direction=Vector(10, 0, 0), Count=10)  # -> Geometry, Transform
